# Dynamo graph Synchronize Revit Key Schedules Using an Excel Master List.dyn (Dynamo 2.0.3.8810)

# group: Select Key Schedule
views = Views()  # nothing selected; graph input

# group: Generate RevitList from Key Schedule and Collect UID Parameters
python_script = Python(IN[0]=views)
# ---------- python_script.python (29 lines) ----------
# Python Node for Dynamo
# Input: Key Schedule
# Output: Keys
# Coded by Andrew King
# https://andrewkingme.com

import clr
clr.AddReference('ProtoGeometry')
from Autodesk.DesignScript.Geometry import *

# Import RevitAPI
clr.AddReference('RevitAPI')
import Autodesk
from Autodesk.Revit.DB import *

# Import DocumentManager and TransactionManager
clr.AddReference('RevitServices')
import RevitServices
from RevitServices.Persistence import DocumentManager
from RevitServices.Transactions import TransactionManager

# Assign input to the IN variables.
keySchedule = UnwrapElement(IN[0])

# Collect keys in key schedule.
keys = FilteredElementCollector(DocumentManager.Instance.CurrentDBDocument, keySchedule.Id).ToElements()

# Assign your output to the OUT variable.
OUT = keys
# ----------------------------------------
code_block = CodeBlock { "Key_UniqueID"; }
getParameterValueByName = Element.GetParameterValueByName(element=python_script, parameterName=code_block)
code_block_2 = CodeBlock { ""; }
ne = _ != code_block_2  # unwired: x
filter = List.Filter(list=getParameterValueByName, condition=ne)
watch = Watch(filter.in)

# group: Select Excel Master
# note: Synchronize Revit Key Schedules Using an Excel Master List
# Version 0.5
# Coded by Andrew King
# https://andrewkingme.com
# 2019-11-14 Version 0.5
# Replace null values from Excel with -/0 to enable overwriting omitted values.
# 2018-04-27 Version 0.4
# Adjusted List.Contains to use Auto Lacing and List@Level, for Dynamo 2.0 compatibility
# 2018-01-30 Version 0.3
# Refactored Graph for Distribution
# 2017-11-07 Version 0.2
# Working Prototype Deployed on Active Project
# 2017-06-23 Version 0.1
# Hello World
file_path = Filename(".\KeySchedule_Master.xlsm")

# group: Generate ExcelList from Excel Master and Collect UID Parameters
fromPath = FileObject(path=file_path)  # "File.FromPath"
code_block_3 = CodeBlock { "RevitKeyScheduleTemplate"; true; }
importExcel = Data.ImportExcel(file=fromPath, sheetName=code_block_3.out0, readAsStrings=code_block_3.out1)
code_block_4 = CodeBlock { 0..3; }
removeItemAtIndex = List.RemoveItemAtIndex(list=importExcel, indices=code_block_4)
code_block_5 = CodeBlock { 2; }
getItemAtIndex = List.GetItemAtIndex(list=removeItemAtIndex@L2, index=code_block_5)
code_block_6 = CodeBlock { null; }
ne_2 = _ != code_block_6  # unwired: x
filter_2 = List.Filter(list=getItemAtIndex, condition=ne_2)
watch_2 = Watch(filter_2.in)

# group: Key/UID Exists in RevitList but not ExcelList
setDifference = List.SetDifference(list1=watch, list2=watch_2)

# group: Overwrite "Key Name" and "Department" Parameters with "UNUSED"
contains = List.Contains(list=setDifference, item=watch@L1)
filterByBoolMask = List.FilterByBoolMask(list=python_script, mask=contains)
code_block_7 = CodeBlock { "Key Name"; "UNUSED"; }
setParameterByName = Element.SetParameterByName(element=filterByBoolMask.in, parameterName=code_block_7.out0, value=code_block_7.out1)
code_block_8 = CodeBlock { "Department"; "UNUSED"; }
setParameterByName_2 = Element.SetParameterByName(element=filterByBoolMask.in, parameterName=code_block_8.out0, value=code_block_8.out1)

# group: Key/UID Exists in Both RevitList and ExcelList
setIntersection = List.SetIntersection(list1=watch, list2=watch_2)

# group: Overwrite Revit Parameters with Excel Data
contains_2 = List.Contains(list=setIntersection, item=watch@L1)
filterByBoolMask_2 = List.FilterByBoolMask(list=python_script, mask=contains_2)
code_block_9 = CodeBlock { "Key_UniqueID"; }
getParameterValueByName_2 = Element.GetParameterValueByName(element=filterByBoolMask_2.in, parameterName=code_block_9)
sortByKey = List.SortByKey(list=filterByBoolMask_2.in, keys=getParameterValueByName_2)
contains_3 = List.Contains(list=setIntersection, item=watch_2@L1)
filterByBoolMask_3 = List.FilterByBoolMask(list=removeItemAtIndex, mask=contains_3)
code_block_10 = CodeBlock { 2; }
getItemAtIndex_2 = List.GetItemAtIndex(list=filterByBoolMask_3.in@L2, index=code_block_10)
sortByKey_2 = List.SortByKey(list=filterByBoolMask_3.in, keys=getItemAtIndex_2)
setParameters = Custom[SynchronizeKeySchedule.SetParameters](RevitList=sortByKey.sorted_list, ExcelList=sortByKey_2.sorted_list)

# group: Key/UID Exists in ExcelList but not RevitList
setDifference_2 = List.SetDifference(list1=watch_2, list2=watch)

# group: Add New Keys to Revit and Assign Parameters
contains_4 = List.Contains(list=setDifference_2, item=watch_2@L1)
filterByBoolMask_4 = List.FilterByBoolMask(list=removeItemAtIndex, mask=contains_4)
count = List.Count(list=filterByBoolMask_4.in)
python_script_2 = Python(IN[0]=views, IN[1]=count)
# ---------- python_script_2.python (50 lines) ----------
# Python Node for Dynamo
# Input: List of Keys to Add
# Output: Keys Added
# Coded by Andrew King
# https://andrewkingme.com

import clr
clr.AddReference('ProtoGeometry')
from Autodesk.DesignScript.Geometry import *

# Import RevitAPI
clr.AddReference('RevitAPI')
import Autodesk
from Autodesk.Revit.DB import *

# Import DocumentManager and TransactionManager
clr.AddReference('RevitServices')
import RevitServices
from RevitServices.Persistence import DocumentManager
from RevitServices.Transactions import TransactionManager

# Assign input to the IN variables.
keySchedule = UnwrapElement(IN[0])
keyCount = IN[1]
newKeys = []

# Start the Transaction
TransactionManager.Instance.EnsureInTransaction(DocumentManager.Instance.CurrentDBDocument)

for i in xrange(keyCount):

	# Create before list of keys in key schedule.
	scheduleBefore = FilteredElementCollector(DocumentManager.Instance.CurrentDBDocument, keySchedule.Id).ToElementIds()
	
	# Add new key to key schedule.
	schedule = keySchedule.GetTableData().GetSectionData(SectionType.Body)
	schedule.InsertRow(schedule.FirstRowNumber + 1)
	
	# Create after list of keys in key schedule.
	scheduleAfter = FilteredElementCollector(DocumentManager.Instance.CurrentDBDocument, keySchedule.Id).ToElementIds()
	
	# Identify new key by comparing before and after lists.
	newRow = list(set(scheduleAfter) - set(scheduleBefore))[0]
	newKeys.append(DocumentManager.Instance.CurrentDBDocument.GetElement(newRow))

# End the Transaction
TransactionManager.Instance.TransactionTaskDone()

# Assign your output to the OUT variable
OUT = newKeys
# ----------------------------------------
setParameters_2 = Custom[SynchronizeKeySchedule.SetParameters](RevitList=python_script_2, ExcelList=filterByBoolMask_4.in)
