# Dynamo custom node SynchronizeKeySchedule.SetParameters.dyf (Dynamo 2.0.3.8810)
# category: andrewking(me)

RevitList = Input(RevitList: var[]..[])
code_block = CodeBlock()
# ---------- code_block.designscript (18 lines) ----------
"Key Name";
"Department";
"Key_UniqueID";
"Key_Data_Text_01";
"Key_Data_Text_02";
"Key_Data_Text_03";
"Key_Data_Text_04";
"Key_Data_Text_05";
"Key_Data_Number_01";
"Key_Data_Number_02";
"Key_Data_Number_03";
"Key_Data_Number_04";
"Key_Data_Number_05";
"Key_Data_Area_01";
"Key_Data_Area_02";
"Key_Data_Area_03";
"Key_Data_Area_04";
"Key_Data_Area_05";
# ----------------------------------------
ExcelList = Input(ExcelList: var[]..[])
code_block_2 = CodeBlock { 0; 1; 2; 3; 4; 5; 6; 7; 8; 9; 10; 11; 12; 13; 14; 15; 16; 17; }
getItemAtIndex = List.GetItemAtIndex(list=ExcelList@L2, index=code_block_2.out0)
code_block_3 = CodeBlock { "-"; "0"; }
isNull = Object.IsNull()  # unwired: obj
replaceByCondition = Replace(item=getItemAtIndex, replaceWith=code_block_3.out0, condition=isNull)
setParameterByName = Element.SetParameterByName(element=RevitList, parameterName=code_block.out0, value=replaceByCondition)
getItemAtIndex_2 = List.GetItemAtIndex(list=ExcelList@L2, index=code_block_2.out1)
replaceByCondition_2 = Replace(item=getItemAtIndex_2, replaceWith=code_block_3.out0, condition=isNull)
setParameterByName_2 = Element.SetParameterByName(element=RevitList, parameterName=code_block.out1, value=replaceByCondition_2)
getItemAtIndex_3 = List.GetItemAtIndex(list=ExcelList@L2, index=code_block_2.out2)
replaceByCondition_3 = Replace(item=getItemAtIndex_3, replaceWith=code_block_3.out0, condition=isNull)
setParameterByName_3 = Element.SetParameterByName(element=RevitList, parameterName=code_block.out2, value=replaceByCondition_3)
getItemAtIndex_4 = List.GetItemAtIndex(list=ExcelList@L2, index=code_block_2.out3)
replaceByCondition_4 = Replace(item=getItemAtIndex_4, replaceWith=code_block_3.out0, condition=isNull)
setParameterByName_4 = Element.SetParameterByName(element=RevitList, parameterName=code_block.out3, value=replaceByCondition_4)
getItemAtIndex_5 = List.GetItemAtIndex(list=ExcelList@L2, index=code_block_2.out4)
replaceByCondition_5 = Replace(item=getItemAtIndex_5, replaceWith=code_block_3.out0, condition=isNull)
setParameterByName_5 = Element.SetParameterByName(element=RevitList, parameterName=code_block.out4, value=replaceByCondition_5)
getItemAtIndex_6 = List.GetItemAtIndex(list=ExcelList@L2, index=code_block_2.out5)
replaceByCondition_6 = Replace(item=getItemAtIndex_6, replaceWith=code_block_3.out0, condition=isNull)
setParameterByName_6 = Element.SetParameterByName(element=RevitList, parameterName=code_block.out5, value=replaceByCondition_6)
getItemAtIndex_7 = List.GetItemAtIndex(list=ExcelList@L2, index=code_block_2.out6)
replaceByCondition_7 = Replace(item=getItemAtIndex_7, replaceWith=code_block_3.out0, condition=isNull)
setParameterByName_7 = Element.SetParameterByName(element=RevitList, parameterName=code_block.out6, value=replaceByCondition_7)
getItemAtIndex_8 = List.GetItemAtIndex(list=ExcelList@L2, index=code_block_2.out7)
replaceByCondition_8 = Replace(item=getItemAtIndex_8, replaceWith=code_block_3.out0, condition=isNull)
setParameterByName_8 = Element.SetParameterByName(element=RevitList, parameterName=code_block.out7, value=replaceByCondition_8)
getItemAtIndex_9 = List.GetItemAtIndex(list=ExcelList@L2, index=code_block_2.out8)
replaceByCondition_9 = Replace(item=getItemAtIndex_9, replaceWith=code_block_3.out1, condition=isNull)
toNumber = String.ToNumber(str=replaceByCondition_9)
setParameterByName_9 = Element.SetParameterByName(element=RevitList, parameterName=code_block.out8, value=toNumber)
getItemAtIndex_10 = List.GetItemAtIndex(list=ExcelList@L2, index=code_block_2.out9)
replaceByCondition_10 = Replace(item=getItemAtIndex_10, replaceWith=code_block_3.out1, condition=isNull)
toNumber_2 = String.ToNumber(str=replaceByCondition_10)
setParameterByName_10 = Element.SetParameterByName(element=RevitList, parameterName=code_block.out9, value=toNumber_2)
getItemAtIndex_11 = List.GetItemAtIndex(list=ExcelList@L2, index=code_block_2.out10)
replaceByCondition_11 = Replace(item=getItemAtIndex_11, replaceWith=code_block_3.out1, condition=isNull)
toNumber_3 = String.ToNumber(str=replaceByCondition_11)
setParameterByName_11 = Element.SetParameterByName(element=RevitList, parameterName=code_block.out10, value=toNumber_3)
getItemAtIndex_12 = List.GetItemAtIndex(list=ExcelList@L2, index=code_block_2.out11)
replaceByCondition_12 = Replace(item=getItemAtIndex_12, replaceWith=code_block_3.out1, condition=isNull)
toNumber_4 = String.ToNumber(str=replaceByCondition_12)
setParameterByName_12 = Element.SetParameterByName(element=RevitList, parameterName=code_block.out11, value=toNumber_4)
getItemAtIndex_13 = List.GetItemAtIndex(list=ExcelList@L2, index=code_block_2.out12)
replaceByCondition_13 = Replace(item=getItemAtIndex_13, replaceWith=code_block_3.out1, condition=isNull)
toNumber_5 = String.ToNumber(str=replaceByCondition_13)
setParameterByName_13 = Element.SetParameterByName(element=RevitList, parameterName=code_block.out12, value=toNumber_5)
getItemAtIndex_14 = List.GetItemAtIndex(list=ExcelList@L2, index=code_block_2.out13)
replaceByCondition_14 = Replace(item=getItemAtIndex_14, replaceWith=code_block_3.out1, condition=isNull)
toNumber_6 = String.ToNumber(str=replaceByCondition_14)
setParameterByName_14 = Element.SetParameterByName(element=RevitList, parameterName=code_block.out13, value=toNumber_6)
getItemAtIndex_15 = List.GetItemAtIndex(list=ExcelList@L2, index=code_block_2.out14)
replaceByCondition_15 = Replace(item=getItemAtIndex_15, replaceWith=code_block_3.out1, condition=isNull)
toNumber_7 = String.ToNumber(str=replaceByCondition_15)
setParameterByName_15 = Element.SetParameterByName(element=RevitList, parameterName=code_block.out14, value=toNumber_7)
getItemAtIndex_16 = List.GetItemAtIndex(list=ExcelList@L2, index=code_block_2.out15)
replaceByCondition_16 = Replace(item=getItemAtIndex_16, replaceWith=code_block_3.out1, condition=isNull)
toNumber_8 = String.ToNumber(str=replaceByCondition_16)
setParameterByName_16 = Element.SetParameterByName(element=RevitList, parameterName=code_block.out15, value=toNumber_8)
getItemAtIndex_17 = List.GetItemAtIndex(list=ExcelList@L2, index=code_block_2.out16)
replaceByCondition_17 = Replace(item=getItemAtIndex_17, replaceWith=code_block_3.out1, condition=isNull)
toNumber_9 = String.ToNumber(str=replaceByCondition_17)
setParameterByName_17 = Element.SetParameterByName(element=RevitList, parameterName=code_block.out16, value=toNumber_9)
getItemAtIndex_18 = List.GetItemAtIndex(list=ExcelList@L2, index=code_block_2.out17)
replaceByCondition_18 = Replace(item=getItemAtIndex_18, replaceWith=code_block_3.out1, condition=isNull)
toNumber_10 = String.ToNumber(str=replaceByCondition_18)
setParameterByName_18 = Element.SetParameterByName(element=RevitList, parameterName=code_block.out17, value=toNumber_10)
create = List.Create(item0=setParameterByName, item1=setParameterByName_2, item2=setParameterByName_3, item3=setParameterByName_4, item4=setParameterByName_5, item5=setParameterByName_6, item6=setParameterByName_7, item7=setParameterByName_8, item8=setParameterByName_9, item9=setParameterByName_10, item10=setParameterByName_11, item11=setParameterByName_12, item12=setParameterByName_13, item13=setParameterByName_14, item14=setParameterByName_15, item15=setParameterByName_16, item16=setParameterByName_17, item17=setParameterByName_18)
